# Grasshopper definition metro.gh (Grasshopper 1.0.7)
# plug-ins: LunchBox, Urbano

file_path = FilePath("C:\Users\bot\projects\munich_new_metro_pbd\data\munich.csv")
read_file = ReadFile(File=file_path, PerLineParse=True)
read_file_2 = ReadFile(File="C:\Users\bot\projects\munich_new_metro_pbd\data\metro_stations.csv", PerLineParse=True)
read_csv = ReadCSV(CSVString=read_file, Delimiter=";")  # -> Headers, Values
panel = Panel(read_csv.Values)
read_csv_2 = ReadCSV(CSVString=read_file_2, Delimiter=";")  # -> Headers, Values
panel_2 = Panel(read_csv.Headers)
panel_3 = Panel(read_csv_2.Headers)
explode_tree = ExplodeTree(Data=read_csv_2.Values)  # -> Branch0, Branch1, Branch2
explode_tree_2 = ExplodeTree(Data=read_csv.Values)  # -> Branch0, Branch1, Branch2, Branch3, Branch4, Branch5
panel_4 = Panel(explode_tree_2.Branch0)
construct_point = ConstructPoint(XCoordinate=explode_tree.Branch2, YCoordinate=explode_tree.Branch1, ZCoordinate=expr("0", 10))
panel_5 = Panel(explode_tree_2.Branch2)
population = Number(explode_tree_2.Branch5)
panel_6 = Panel(explode_tree_2.Branch1)
bounds = Bounds(Numbers=population)
panel_7 = Panel(population)
project_geographic_point = ProjectGeographicPoint(Point=construct_point, Projection="WSG84 -> UTM", UTMZone="32")  # -> Out, UTMZone
panel_8 = Panel(construct_point)
construct_domain = ConstructDomain(DomainStart=Slider(100, range=1..3000), DomainEnd=Slider(1000, range=1..3000))
parse_polygon = CSharpScript(x=explode_tree_2.Branch2)  # -> out, A; inputs x: String
# ---------- parse_polygon: C# ----------
    var outList = new List<Point3d>();
    var cleanString = x.Substring(10, x.Length - 2 - 10);
    var textCoords = cleanString.Split(',');
    foreach (string textCoord in textCoords){
      var coords = textCoord.Trim().Split(' ');
      //Print(textCoord);
      //Print(coords.Length.ToString());
      //Print("-------");
      outList.Add(new Point3d(double.Parse(coords[0]), double.Parse(coords[1]), 0));
    }
    A = outList;
# ---------- end parse_polygon ----------
panel_9 = Panel(parse_polygon.out)
existing_metro_stations = Point(project_geographic_point.Out)
remap_numbers = RemapNumbers(Value=population, Source=bounds, Target=construct_domain)  # -> Mapped, Clipped
project_geographic_point_2 = ProjectGeographicPoint(Point=parse_polygon.A, Projection="WSG84 -> UTM")  # -> Out, UTMZone
panel_10 = Panel(parse_polygon.A)
unit_z = UnitZ(Factor=1000)
unit_z_2 = UnitZ(Factor=remap_numbers.Mapped)
move = Move(Geometry=existing_metro_stations, Motion=unit_z)  # -> Geometry, Transform
panel_11 = Panel(project_geographic_point_2.Out)
polyline = PolyLine(Vertices=project_geographic_point_2.Out, Closed=True)
boundary_surfaces = BoundarySurfaces(Edges=polyline)
map2d = Surface(flatten(boundary_surfaces))
extrude = Extrude(Base=map2d, Direction=unit_z_2)

# ---- group: Density
area = Area(Geometry=map2d)  # -> Area, Centroid
panel_12 = Panel(area.Area)  # disabled
division = Division(A=population, B=area.Area)

# ---- group: Sample Points
mesh_join = MeshJoin(Meshes=extrude)
bounding_box = BoundingBox(Content=mesh_join, Plane=PlaneXY(0, 0, 0))  # -> Box, Box_2
deconstruct_brep = DeconstructBrep(Brep=bounding_box.Box)  # -> Faces, Edges, Vertices
bounds_2 = ListItem(List=deconstruct_brep.Faces, Index=Slider(4, range=0..5), Wrap=True)
precision = Slider(329, range=100..2000)
dimensions = Dimensions(Surface=bounds_2)  # -> UDimension, VDimension
division_2 = Division(A=dimensions.UDimension, B=precision)
division_3 = Division(A=dimensions.VDimension, B=precision)
divide_surface = DivideSurface(Surface=bounds_2, UCount=division_2, VCount=division_3)  # -> Points, Normals, Parameters

# ----
panel_13 = Panel(division)  # disabled
bounds_3 = Bounds(Numbers=division)
panel_14 = Panel(bounds_3)  # disabled
deconstruct_domain = DeconstructDomain(Domain=bounds_3)  # -> Start, End
gradient = Gradient(
    LowerLimit=deconstruct_domain.Start,
    UpperLimit=deconstruct_domain.End,
    Parameter=division,
    stops=[0: RGB(0, 128, 0), 0.5: RGB(255, 255, 0), 1: RGB(255, 0, 0)])
custom_preview = CustomPreview(Geometry=extrude, Material=gradient)
multiplication = Multiplication(A=precision, B=precision)
# 2x number of new metro stations
gene_pool = GenePool(Decimals=2, Maximum=100, Minimum=0, Value=[45.12, 53.01, 31.84, 53.58, 45.59, 52.5, 45.44, 52.96, 45.14, 52.46])

# ---- group: Map Domain
sort_points = SortPoints(Points=deconstruct_brep.Vertices)  # -> Points, Indices
list_item = ListItem(List=sort_points.Points, Index=0, Wrap=True)
list_item_2 = ListItem(List=sort_points.Points, Index=-1, Wrap=True)
deconstruct = Deconstruct(Point=list_item)  # -> XComponent, YComponent, ZComponent
deconstruct_2 = Deconstruct(Point=list_item_2)  # -> XComponent, YComponent, ZComponent
construct_domain_2 = ConstructDomain(DomainStart=deconstruct.XComponent, DomainEnd=deconstruct_2.XComponent)
construct_domain_3 = ConstructDomain(DomainStart=deconstruct.YComponent, DomainEnd=deconstruct_2.YComponent)

# ----
galapagos = Galapagos(fitness=integrate_population, gene=gene_pool)
list_length = ListLength(List=gene_pool)
series = Series(Start=0, Step=1, Count=list_length)

# ---- group: Population Density Samples
point_in_breps = PointInBreps(Brep=extrude, Point=divide_surface.Points, Strict=False)  # -> Inside, Index
panel_15 = Panel(point_in_breps.Inside)  # disabled
panel_16 = Panel(point_in_breps.Index)  # disabled
region_sample = ListItem(List=extrude, Index=point_in_breps.Index, Wrap=False)
population_sample = ListItem(List=population, Index=point_in_breps.Index, Wrap=False)
area_2 = Area(Geometry=region_sample)  # -> Area, Centroid
panel_17 = Panel(population_sample)  # disabled
panel_18 = Panel(region_sample)  # disabled
division_4 = Division(A=population_sample, B=area_2.Area)
population_density_sample = Number(division_4)
panel_19 = Panel(population_density_sample)  # disabled

# ----
modulus = Modulus(A=series, B=2)
dispatch = Dispatch(List=gene_pool, DispatchPattern=modulus)  # -> ListA, ListB
remap_numbers_2 = RemapNumbers(Value=dispatch.ListA, Source=Domain(0, 100), Target=construct_domain_2)  # -> Mapped, Clipped
remap_numbers_3 = RemapNumbers(Value=dispatch.ListB, Source=Domain(0, 100), Target=construct_domain_3)  # -> Mapped, Clipped
existing_metro_stations_2 = Point(existing_metro_stations)
construct_point_2 = ConstructPoint(XCoordinate=remap_numbers_2.Clipped, YCoordinate=remap_numbers_3.Clipped, ZCoordinate=0)
unit_z_3 = UnitZ(Factor=1000)
move_2 = Move(Geometry=construct_point_2, Motion=unit_z_3)  # -> Geometry, Transform
merge_lists = CSharpScript(listA=existing_metro_stations_2, listB=construct_point_2)  # -> out, mergedList; inputs listA: list of Point3d, listB: list of Point3d
# ---------- merge_lists: C# ----------
    var list = new List<Point3d>();
    list.AddRange(listA);
    list.AddRange(listB);
    mergedList = list;
# ---------- end merge_lists ----------
colour = Colour(RGB(0, 0, 255))
panel_20 = Panel(merge_lists.mergedList)
custom_preview_2 = CustomPreview(Geometry=move_2.Geometry, Material=colour)
sigma = Z(1000)
integrate_population = CSharpScript(
    samplePoints=flatten(divide_surface.Points),
    sampleValues=flatten(population_density_sample),
    stationsPos=merge_lists.mergedList,
    sigma=sigma,
    dA=multiplication)  # -> out, value; inputs samplePoints: list of Point3d, sampleValues: list of Double, stationsPos: list of Point3d, sigma: Double, dA: Double
# ---------- integrate_population: C# ----------
    double sigmaSq = sigma * sigma;
    double val = 0;
    foreach(var station in stationsPos){
      for(int i = 0; i < samplePoints.Count; i++){
        Point3d point = samplePoints[i];
        double density = sampleValues[i];
        double distSq = point.DistanceToSquared(station);
        //Print(string.Format("Density {0} dist {1}", density, distSq));
        val += density * Math.Exp(-distSq / sigmaSq);
      }
    }
    value = dA * val;
# ---------- end integrate_population ----------
panel_21 = Panel(integrate_population.out)
panel_22 = Panel(integrate_population.value)
